test file "TestSuite"
  coverage: Decision

suite "New Test Suite 1"

  case "New Test Case 1" [baseline]
    model state, harness state_Harness1 (for state/Chart)
    test sequence scenario: Scenario_Close_Open (state_Harness1/Test Sequence)

  case "New Test Case 2" [baseline]
    model state, harness state_Harness2 (for state/Chart)

  case "New Test Case 3" [baseline]
    model state, harness state_Harness3 (for state/Chart)

  case "New Test Case 4" [baseline]
    model state, harness state_Harness4 (for state/Chart)

  case "New Test Case 5" [baseline]
    model state, harness state_Harness6 (for state/Chart)

  case "New Test Case 6" [baseline]
    model state, harness state_Harness7 (for state/Chart)

  case "New Test Case 7" [baseline]
    model state, harness state_Harness8 (for state/Chart)

  case "New Test Case 8" [baseline]
    model state, harness state_Harness9 (for state/Chart)